# Grasshopper definition topography+NDVI.gh (Grasshopper 0.9.76)
# plug-ins: MeshEdit Components, RasterGrid, ReadRasterData

panel = Panel("C:\Users\starsky\stealingfire\nero101\data\hongkong\NERO\_NERO101\ASTER GLOBAL DEM\ASTGTM2_N21E113-N21E114-N22E113-N22E114-N23E113-N23E114_newResolution.tif")
raster = ReadRaster(ImagePath=panel, RunRaster=Toggle(True))  # -> XYSize, ImageDriver, BANDs, Metadata, R
pt = ConstructPoint(XCoordinate=0, YCoordinate=0, ZCoordinate=0)
grid = RasterGrid(Localization=pt, XYSize=raster.XYSize)
Z = UnitZ(Factor=raster.R)
dom = ConstructDomain(DomainStart=Slider(50, range=0..255), DomainEnd=Slider(255, range=0..255))
bnd = Bounds(Numbers=raster.R)
scale_nu = ScaleNU(Geometry=grid, Plane=pt, ScaleX="30.0022", ScaleY="30.008", ScaleZ=1)  # -> Geometry, Transform
remap = RemapNumbers(Source=bnd, Target=dom)  # -> Mapped, Clipped
move = Move(Geometry=scale_nu.Geometry, Motion=Z)  # -> Geometry, Transform
split = TextSplit(Separators=",")
rgb = ColourRGB(Alpha=255, Red=0, Green=0, Blue=remap.Mapped)
item = ListItem(List=split, Index=0, Wrap=True)  # -> Item, Item1
frompoints = MeshFromPoints(Points=move.Geometry, UDirection=item.Item1, VDirection=item.Item, Colour=rgb)
